# Grasshopper definition losmanantiales.gh (Grasshopper 0.9.76)

# ---- group: INPUT
num_hypar = Slider(8, range=0..10)
lenght_hypar = Slider(125.607, range=0..150)
overhang = Slider(15.166, range=0..30)
num_generatrix_hypar = Slider(10, range=0..20)
width_hypar = Slider(22.621, range=2..50)
h_vertex_hypar = Slider(100, range=30..100)

# ---- group: HYPAR SURFACE FROM NETWORK OF GENERATRIX
negative = Negative(Value=width_hypar)
negative_2 = Negative(Value=lenght_hypar)
construct_point = ConstructPoint(XCoordinate=0, YCoordinate=0, ZCoordinate=0)
unit_x = UnitX(Factor=width_hypar)
unit_x_2 = UnitX(Factor=negative)
vector_xyz = VectorXYZ(XComponent=0, YComponent=negative_2, ZComponent=h_vertex_hypar)  # -> Vector, Length
vector_xyz_2 = VectorXYZ(XComponent=0, YComponent=lenght_hypar, ZComponent=h_vertex_hypar)  # -> Vector, Length
move = Move(Geometry=construct_point, Motion=unit_x)  # -> Geometry, Transform
move_2 = Move(Geometry=construct_point, Motion=unit_x_2)  # -> Geometry, Transform
move_3 = Move(Geometry=construct_point, Motion=vector_xyz_2.Vector)  # -> Geometry, Transform
move_4 = Move(Geometry=construct_point, Motion=vector_xyz.Vector)  # -> Geometry, Transform
line = Line(StartPoint=move.Geometry, EndPoint=move_3.Geometry)
line_2 = Line(StartPoint=move_3.Geometry, EndPoint=move_2.Geometry)
line_3 = Line(StartPoint=move_4.Geometry, EndPoint=move_2.Geometry)
line_4 = Line(StartPoint=move.Geometry, EndPoint=move_4.Geometry)
divide_curve = DivideCurve(Curve=[line, line_3], Count=num_generatrix_hypar, Kinks=False)  # -> Points, Tangents, Parameters
divide_curve_2 = DivideCurve(Curve=[line_2, line_4], Count=num_generatrix_hypar, Kinks=False)  # -> Points, Tangents, Parameters
flip_matrix = FlipMatrix(Data=divide_curve.Points)
flip_matrix_2 = FlipMatrix(Data=divide_curve_2.Points)
polyline = PolyLine(Vertices=flip_matrix, Closed=False)  # -> flatten(Polyline)
polyline_2 = PolyLine(Vertices=flip_matrix_2, Closed=False)  # -> flatten(Polyline)
network_surface = NetworkSurface(CurvesU=polyline, CurvesV=polyline_2, Continuity=2)

# ---- group: CUTTING PLANES
radians = Radians(Degrees=Slider(360, range=0..1000))
multiplication = Multiplication(A=num_hypar, B=Slider(2, range=0..10))
division = Division(A=radians, B=multiplication)
unit_x_3 = UnitX(Factor=1)
negative_3 = Negative(Value=division)
rotate = Rotate(Vector=unit_x_3, Axis=Vector(0, 0, 1), Angle=[division, negative_3])
plane_normal = PlaneNormal(Origin=Point(0, 0, 0), ZAxis=rotate)

# ---- group: CUTTING HYPAR WITH PLANES
brep_plane = BrepPlane(Brep=network_surface, Plane=plane_normal)  # -> flatten(Curves), Points
surface_split = SurfaceSplit(Surface=network_surface, Curves=brep_plane.Curves)
list_item = ListItem(List=surface_split, Index=2, Wrap=True)
deconstruct_brep = DeconstructBrep(Brep=list_item)  # -> Faces, Edges, Vertices
list_item_2 = ListItem(List=deconstruct_brep.Vertices, Index=[2, 3], Wrap=True)
polyline_3 = PolyLine(Vertices=list_item_2, Closed=False)
average = Average(Input=list_item_2)
length = Length(Curve=polyline_3)  # -> expr("x*10", Length)
line_sdl = LineSDL(Start=average, Direction=Vector(0, 0, 1), Length=length)
surface_line = SurfaceLine(Surface=list_item, Line=line_sdl, LimitToFirst=False)  # -> Curves, Points, UVPoints, Normal
unit_y = UnitY(Factor=overhang)
move_5 = Move(Geometry=surface_line.Points, Motion=unit_y)  # -> Geometry, Transform
vector_2pt = Vector2Pt(PointA=average, PointB=move_5.Geometry, Unitize=False)  # -> Vector, Length
construct_plane = ConstructPlane(Origin=average, XAxis=Vector(1, 0, 0), YAxis=vector_2pt.Vector)
brep_plane_2 = BrepPlane(Brep=list_item, Plane=construct_plane)  # -> flatten(Curves), Points
surface_split_2 = SurfaceSplit(Surface=list_item, Curves=brep_plane_2.Curves)
hypar = ListItem(List=surface_split_2, Index=0, Wrap=True)

# ---- group: POLAR ARRAY AND MOVE AT GROUND LEVEL
list_item_3 = ListItem(List=list_item_2, Index=0, Wrap=True)
deconstruct = Deconstruct(Point=list_item_3)  # -> XComponent, YComponent, expr("-x", ZComponent)
polar_array = PolarArray(Geometry=hypar, Plane=PlaneXY(0, 0, 0), Count=num_hypar, Angle=6.283185307)  # -> Geometry, Transform
unit_z = UnitZ(Factor=deconstruct.ZComponent)
move_6 = Move(Geometry=[polyline, polyline_2], Motion=unit_z)  # -> Geometry, Transform
move_7 = Move(Geometry=polar_array.Geometry, Motion=unit_z)  # -> Geometry, Transform
